# Grasshopper definition 2023.08.09-柱面网壳参数化生成.gh (Grasshopper 1.0.7)
# plug-ins: LunchBox

# 长度
L = Slider(96587, range=0..100000)
# 柱面网壳划分
# 跨度
f = Slider(37660, range=0..100000)
# 矢高
h = Slider(8872, range=0..10000)
pt = ConstructPoint(XCoordinate=expr("x/2", f), YCoordinate=0, ZCoordinate=0)
pt_2 = ConstructPoint(XCoordinate=expr("-x/2", f), YCoordinate=0, ZCoordinate=0)
pt_3 = ConstructPoint(XCoordinate=0, YCoordinate=0, ZCoordinate=h)
Y = UnitY(Factor=L)
arc = Arc3Pt(PointA=pt, PointB=pt_3, PointC=pt_2)  # -> Arc, Plane, Radius
extr = Extrude(Base=arc.Arc, Direction=Y)
X = UnitX(Factor=Slider(-50000, range=-50000..100000))
X_2 = UnitX(Factor=Slider(50000, range=0..100000))
X_3 = UnitX(Factor=Slider(100000, range=0..100000))
X_4 = UnitX(Factor=Slider(150000, range=0..1000000))
move = Move(Geometry=extr, Motion=X)  # -> Geometry, Transform
move_2 = Move(Geometry=extr, Motion=X_2)  # -> Geometry, Transform
move_3 = Move(Geometry=extr, Motion=X_3)  # -> Geometry, Transform
move_4 = Move(Geometry=extr, Motion=X_4)  # -> Geometry, Transform

# ----
# 划分3
number_slider = Slider(18, range=0..50)
srf = Surface(reparameterize(move_4.Geometry))
tric = TrianglePanelsC(Surface=srf, UDivisions=number_slider, VDivisions=Slider(10, range=0..50))
edges = BrepEdges(Brep=tric)  # -> Naked, Interior, NonManifold

# ----
# 划分1
number_slider_2 = Slider(10, range=0..50)
srf_2 = Surface(reparameterize(extr))
cluster = Cluster(S=srf_2, nx=Slider(20, range=0..50), ny=number_slider_2)
mesh = Mesh(cluster)
medges = MeshEdges(Mesh=mesh)  # -> NakedEdges, InteriorEdges, NonManifoldEdges

# ----
# 划分2
number_slider_3 = Slider(30, range=0..50)
srf_3 = Surface(reparameterize(move_2.Geometry))
diamond = DiamondPanels(Surface=srf_3, UDivisions=number_slider_3, VDivisions=Slider(20, range=0..50))  # -> DiamondPanels, TriPanels
edges_2 = BrepEdges(Brep=diamond.DiamondPanels)  # -> Naked, Interior, NonManifold
edges_3 = BrepEdges(Brep=diamond.TriPanels)  # -> Naked, Interior, NonManifold
merge = Merge(Data1=edges_2.Naked, Data2=edges_3.Naked)

# ----
# 划分3
number_slider_4 = Slider(18, range=0..50)
srf_4 = Surface(reparameterize(move_3.Geometry))
tria = TriangularPanelsA(Surface=srf_4, UDivisions=number_slider_4, VDivisions=Slider(10, range=0..50))
edges_4 = BrepEdges(Brep=tria)  # -> Naked, Interior, NonManifold

# ----
# 划分0
number_slider_5 = Slider(10, range=0..50)
srf_5 = Surface(reparameterize(move.Geometry))
revsrf = ReverseSurfaceDirection(Surface=srf_5, ReverseOption=3)
cluster_2 = Cluster(S=revsrf, nx=number_slider_5, ny=Slider(20, range=0..50))
mesh_2 = Mesh(cluster_2)
medges_2 = MeshEdges(Mesh=mesh_2)  # -> NakedEdges, InteriorEdges, NonManifoldEdges

# ==== cluster Cluster
nx = ClusterInput()
ny = ClusterInput()
python = GhPythonScript(nx=nx, ny=ny)  # -> out, uv, pt; inputs nx: Int32, ny: Int32
# ---------- python: Python ----------
__author__ = "Zn"
__version__ = "2023.03.02"

import rhinoscriptsyntax as rs



dx = 1 / nx
dy = 1 / ny

y0 = []
y1 = []

for i in range(ny + 1):
    y0.append(i*dy)
y1.append(0)
for i in range(ny):
    y1.append(i*dy + dy/2)
y1.append(1)


pt = []
uv = []
for i in range(nx+1):
    nowx = i*dx
    if i%2 == 0:
        for y in y0:
            pt.append(rs.CreatePoint(nx*nowx,ny*y,0))
            uv.append(rs.CreatePoint(nowx,y,0))
    else:
        for y in y1:
            pt.append(rs.CreatePoint(nx*nowx,ny*y,0))
            uv.append(rs.CreatePoint(nowx,y,0))
# ---------- end python ----------
S = ClusterInput()
pt = Point(python.pt)
evalsrf = EvaluateSurface(Surface=S, Point=python.uv)  # -> Point, Normal, UDirection, VDirection, Frame
del = DelaunayMesh(Points=pt, Plane=PlaneXY(0, 0, 0))
demesh = DeconstructMesh(Mesh=del)  # -> Vertices, Faces, Colours, Normals
conmesh = ConstructMesh(Vertices=evalsrf.Point, Faces=demesh.Faces)
M = ClusterOutput(conmesh)
