# Grasshopper definition 2023.08.07-曲面上建立几何形体.gh (Grasshopper 1.0.7)

# 曲面映射
# 原曲面
geo = Geometry(<brep referenced from the Rhino model>)
# 物体 (曲面、曲线、网格)
geo_2 = Geometry(<brep referenced from the Rhino model>)
# 曲面衔接
toggle = BooleanToggle(False)
cluster = Cluster(pt=toggle, geo_2=geo, geo=geo_2)  # -> S, B
geo_3 = Geometry(cluster.B)
swatch = ColourSwatch(SwatchColor=RGB(255, 166, 0))
swatch_2 = ColourSwatch(SwatchColor=RGB(82, 255, 0))
swatch_3 = ColourSwatch(SwatchColor=RGB(255, 255, 255))
srf = Surface(cluster.S)
preview = CustomPreview(Geometry=srf, Material=swatch_3)
preview_2 = CustomPreview(Geometry=cluster.B, Material=swatch_3)

# ==== cluster Cluster
pt = ClusterInput()
geo = ClusterInput()
squisher_parameters = SquisherParameters(
    AbsoluteLimit=0,
    Algorithm=False,
    BoundaryCompressConstant=1,
    BoundaryStretchConstant=1,
    InteriorCompressConstant=1,
    InteriorStretchConstant=1,
    PreserveTopology=pt,
    SaveMapping=True)
python = GhPythonScript(geo=geo)  # -> out, mesh, curve, surface; inputs geo: list of GeometryBase
# ---------- python: Python ----------
__author__ = "Zn"
__version__ = "2023.03.16"

import Rhino.Geometry as rg
import rhinoscriptsyntax as rs


mesh = []
curve = []
surface = []

for i in geo:
    print type(i)
    if type(i) == rg.Mesh:
        
        mesh.append(i)
    elif type(i) == rg.Brep:
        surface.append(i)
    else:
        curve.append(i)
# ---------- end python ----------
mesh = Mesh(python.mesh)
crv = Curve(python.curve)
srf = Surface(python.surface)
geo_2 = ClusterInput()

# ----
# 多重曲面的问题
# 曲面
srf_2 = Surface(srf)
geo_3 = Geometry(geo_2)
srfpt = SurfacePoints(Surface=srf_2)  # -> Points, Weights, Greville, UCount, VCount
squisher = Squisher(Geometry=geo_3, Parameters=squisher_parameters)  # -> Squished, Mapped
project = Project(Geometry=srfpt.Points, Plane=PlaneXY(0, 0, 0))  # -> Geometry, Transform
pt_2 = Point(project.Geometry)
squish_back = SquishBack(Squished=squisher.Squished, Geometry=pt_2)
geo_4 = Geometry(geo_3)
srf_cp = SurfaceClosestPoint(Point=squish_back, Surface=geo_4)  # -> Point, UVPoint, Distance
pdecon = Deconstruct(Point=srfpt.Points)  # -> XComponent, YComponent, ZComponent
evalsrf = EvaluateSurface(Surface=geo_4, Point=srf_cp.UVPoint)  # -> Point, Normal, UDirection, VDirection, Frame
multiplication = Multiplication(A=evalsrf.Normal, B=pdecon.ZComponent)
addition = Addition(A=evalsrf.Point, B=multiplication)
python_2 = GhPythonScript(srf=graft(srf_2), y=addition)  # -> out, flatten(a), b; inputs srf: Surface, y: list of Point3d
# ---------- python_2: Python ----------
__author__ = "Zn"
__version__ = "2023.03.16"

import copy
import Rhino.Geometry as rg
import rhinoscriptsyntax as rs
import scriptcontext
import System.Guid


nsrf = srf.ToNurbsSurface()
print srf.IsSolid


nsrf2 = copy.deepcopy(nsrf)

pts = nsrf2.Points

unum = nsrf2.OrderU
vnum = nsrf2.OrderV



# y[-1].Z += 0.000001

u = pts.CountU
v = pts.CountV

num = 0 
for i in range(u):
    for j in range(v):
        
        cpt = pts.GetControlPoint(i,j)
        cpt = rg.ControlPoint(y[num].X*cpt.Weight,y[num].Y*cpt.Weight,y[num].Z*cpt.Weight,cpt.Weight)
        nsrf2.Points.SetControlPoint(i,j,cpt)
        num += 1


a = nsrf2

b = nsrf2.ToBrep()
# b.JoinSurfaces(0.1)



print type(a),type(b)


#print sc.doc.Objects.AddSurface(b)

#print scriptcontext.doc.Objects.AddBrep(b)
#scriptcontext.doc.Views.Redraw()
#


print a.IsSolid
# ---------- end python_2 ----------
geo_5 = Geometry(python_2.a)
geo_6 = Geometry(python_2.b)

# ----
# 网格
mesh_2 = Mesh(mesh)
demesh = DeconstructMesh(Mesh=mesh_2)  # -> Vertices, Faces, Colours, Normals
project_2 = Project(Geometry=demesh.Vertices, Plane=PlaneXY(0, 0, 0))  # -> Geometry, Transform
geo_7 = Geometry(geo_3)
pt_3 = Point(project_2.Geometry)
squish_back_2 = SquishBack(Squished=squisher.Squished, Geometry=pt_3)
pdecon_2 = Deconstruct(Point=demesh.Vertices)  # -> XComponent, YComponent, ZComponent
srf_cp_2 = SurfaceClosestPoint(Point=squish_back_2, Surface=geo_7)  # -> Point, UVPoint, Distance
evalsrf_2 = EvaluateSurface(Surface=geo_7, Point=srf_cp_2.UVPoint)  # -> Point, Normal, UDirection, VDirection, Frame
multiplication_2 = Multiplication(A=evalsrf_2.Normal, B=pdecon_2.ZComponent)
addition_2 = Addition(A=evalsrf_2.Point, B=multiplication_2)
conmesh = ConstructMesh(Vertices=addition_2, Faces=demesh.Faces)
mesh_3 = Mesh(flatten(conmesh))

S = ClusterOutput(squisher.Squished)

# ----
# 曲线
squish_back_3 = SquishBack(Squished=squisher.Squished, Geometry=crv)
geo_8 = Geometry(squish_back_3)

merge = Merge(Data1=python_2.a, Data2=geo_8, Data3=mesh_3)  # -> flatten(Result)
null = NullItem(Item=merge)  # -> NullFlags, InvalidFlags, Description
dispatch = Dispatch(List=merge, DispatchPattern=null.NullFlags)  # -> ListA, ListB
B = ClusterOutput(dispatch.ListB)
