# Grasshopper definition 空间结构建模工具.gh (Grasshopper 1.0.7)

crv = Curve(reparameterize(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))  # disabled
# 矩形空间桁架
crv_2 = Curve(reparameterize(<curve referenced from the Rhino model>))
num = Number(Slider(8, range=0..15))
num_2 = Number(Slider(3363, range=0..5000))
num_3 = Number(Slider(2497, range=0..5000))
num_4 = Number(Slider(8, range=0..15))
num_5 = Number(Slider(3363, range=0..5000))
num_6 = Number(Slider(2497, range=0..5000))
# 矩形桁架
python = GhPythonScript(crv=crv, n=num, h=num_2, b=num_3)  # -> out, pts, lines1, lines2, lines3, lines4, lines5; inputs n: Int32
# ---------- python: Python ----------
__author__ = "Zn"
__version__ = "2023.08.10"

import rhinoscriptsyntax as rs

#
pts = []

n = n*2

# 生成点
paras = []
dx = 1/n
for i in range(n+1):
    paras.append(i*dx)

pts_cen = []
normal_cen = []
for i in paras:
    pts_cen.append(rs.EvaluateCurve(crv,i))
    normal_cen.append(rs.VectorRotate(rs.CurveTangent(crv,i),90,(0,0,1)))

# 生成点
vecz = rs.CreateVector(0,0,1)
for i in range(n+1):
    pts.append(pts_cen[i] + b/2*normal_cen[i])
for i in range(n+1):
    pts.append(pts_cen[i] - b/2*normal_cen[i])
for i in range(n+1):
    pts.append(pts_cen[i] + b/2*normal_cen[i] - h*vecz)
for i in range(n+1):
    pts.append(pts_cen[i] - b/2*normal_cen[i] - h*vecz)


# 生成直线


# 弦杆
eleij = []
lines1 = []
for i in range(n):
    for j in range(4):
        eleij.append([i+j*(n+1),i+1+j*(n+1)])
for i in eleij:
    lines1.append(rs.AddLine(pts[i[0]],pts[i[1]]))

# 竖杆
eleij = []
lines2 = []
for i in range(n + 1):
    eleij.append([i,i+2*(n+1)])
    eleij.append([i+1*(n+1),i+3*(n+1)])
for i in eleij:
    lines2.append(rs.AddLine(pts[i[0]],pts[i[1]]))

# 横杆
eleij = []
lines3 = []
for i in range(n + 1):
    eleij.append([i,i+1*(n+1)])
    eleij.append([i+2*(n+1),i+3*(n+1)])
for i in eleij:
    lines3.append(rs.AddLine(pts[i[0]],pts[i[1]]))

# 斜杆
eleij = []
lines4 = []
for i in range(int(n/2)):
    eleij.append([2*i+1+2*(n+1),2*i])
    eleij.append([2*i+1+2*(n+1),2*i+2])
    eleij.append([2*i+1+3*(n+1),2*i+1*(n+1)])
    eleij.append([2*i+1+3*(n+1),2*i+2+1*(n+1)])
for i in eleij:
    lines4.append(rs.AddLine(pts[i[0]],pts[i[1]]))


# 水平斜杆
eleij = []
lines5 = []
for i in range(int(n/2)):
    eleij.append([2*i+1+1*(n+1),2*i])
    eleij.append([2*i+1+1*(n+1),2*i+2])
    eleij.append([2*i+1+3*(n+1),2*i+2*(n+1)])
    eleij.append([2*i+1+3*(n+1),2*i+2+2*(n+1)])
for i in eleij:
    lines5.append(rs.AddLine(pts[i[0]],pts[i[1]]))

pts = pts
# ---------- end python ----------
python_2 = GhPythonScript(crv=crv_2, n=num_4, h=num_5, b=num_6)  # -> out, pts, lines1, lines2, lines3, lines4, lines5; inputs n: Int32; same code as python
line = Line(python.lines1)
line_2 = Line(python.lines2)
line_3 = Line(python.lines4)
line_4 = Line(python.lines3)
line_5 = Line(python.lines5)
line_6 = Line(python_2.lines1)
line_7 = Line(python_2.lines2)
line_8 = Line(python_2.lines3)
line_9 = Line(python_2.lines4)
line_10 = Line(python_2.lines5)
merge = Merge(Data1=line_2, Data2=line_4, Data3=line_3, Data4=line_5)
merge_2 = Merge(Data1=line_7, Data2=line_8, Data3=line_9, Data4=line_10)
cluster = Cluster(C=merge, R=Slider(100, range=0..1000))
cluster_2 = Cluster(C=line, R=Slider(150, range=0..1000))
cluster_3 = Cluster(C=line_6, R=Slider(150, range=0..1000))
cluster_4 = Cluster(C=merge_2, R=Slider(100, range=0..1000))
preview = CustomPreview(Geometry=[cluster_3, cluster_4], Material=ColourSwatch(SwatchColor=RGB(255, 255, 255)))
preview_2 = CustomPreview(Geometry=[cluster_2, cluster], Material=ColourSwatch(SwatchColor=RGB(255, 255, 255)))

# ==== cluster Cluster
C = ClusterInput()
R = ClusterInput()
range = Range(Domain=Domain(0, 1), Steps=3)
range_2 = Range(Domain=Domain(0, 1), Steps=10)
parampipemsh = ParameterPipeMesh(
    Curve=C,
    Radius=R,
    ParametersU=range,
    ParametersV=range_2,
    Weighted=False,
    Lengths=False,
    Angle=0,
    Rotation=0,
    EndType=0,
    Triangulate=False)
P = ClusterOutput(parampipemsh)
